# Dynamo graph 01_Hello_Vive.dyn (Dynamo 1.3.0.862)

boolean = BoolSelector(false)
connectToVive = Start.ConnectToVive(boolean)
code_block = CodeBlock { 0; }
boolean_2 = BoolSelector(true)
boolean_3 = BoolSelector(true)
genericTracker = Devices.GenericTracker(connectToVive.out1, code_block, boolean_2, boolean_3)
code_block_2 = CodeBlock { 1; }
boolean_4 = BoolSelector(true)
boolean_5 = BoolSelector(true)
genericTracker_2 = Devices.GenericTracker(connectToVive.out1, code_block_2, boolean_4, boolean_5)
boolean_6 = BoolSelector(true)
boolean_7 = BoolSelector(true)
HMD = Devices.HMD(connectToVive.out1, arg2=boolean_6, arg3=boolean_7)
boolean_8 = BoolSelector(true)
boolean_9 = BoolSelector(true)
controller = Devices.Controller(connectToVive.out1, arg2=boolean_8, arg3=boolean_9)
code_block_3 = CodeBlock { 1; }
boolean_10 = BoolSelector(true)
boolean_11 = BoolSelector(true)
controller_2 = Devices.Controller(connectToVive.out1, code_block_3, boolean_10, boolean_11)
boolean_12 = BoolSelector(true)
boolean_13 = BoolSelector(true)
lighthouse = Devices.Lighthouse(connectToVive.out1, arg2=boolean_12, arg3=boolean_13)
code_block_4 = CodeBlock { 1; }
boolean_14 = BoolSelector(true)
boolean_15 = BoolSelector(true)
lighthouse_2 = Devices.Lighthouse(connectToVive.out1, code_block_4, boolean_14, boolean_15)
