# Dynamo graph 02_Surface_Painting.dyn (Dynamo 1.3.0.862)

track_vive = BoolSelector(false)
connectToVive = Start.ConnectToVive(track_vive)
preview_device_meshes = BoolSelector(true)

# group: Use controller to sculpt and record data
create = DataRecorder.Create()
controller = Devices.Controller(connectToVive.out1, arg3=preview_device_meshes)
record = DataRecorder.Record(create, controller.out1, controller.out3, controller.out6)

spatial_traces = Object.Identity(record)
surface_width = DoubleSlider(0.8, range=0..1 step 0.01)

# group: SURFACE MODELING PREVISUALIZATION
flatten = Flatten(spatial_traces)
origin = CoordinateSystem.Origin(flatten)
YAxis = CoordinateSystem.YAxis(flatten)
surf_width = Object.Identity(surface_width)
code_block = CodeBlock(w=surf_width) { w; w0 = 0.5* w; w1 = -0.5 * w; }
scale = Vector.Scale(vector=YAxis, scale_factor=code_block.w0)
translate = Geometry.Translate(geometry=origin, direction=scale)
byPoints = NurbsCurve.ByPoints(translate)
scale_2 = Vector.Scale(vector=YAxis, scale_factor=code_block.w1)
translate_2 = Geometry.Translate(geometry=origin, direction=scale_2)
byPoints_2 = NurbsCurve.ByPoints(translate_2)
create_2 = List.Create(byPoints, byPoints_2)
byLoft = Surface.ByLoft(create_2)
byStartPointEndPoint = Line.ByStartPointEndPoint(startPoint=translate_2, endPoint=translate)  # frozen
